% Simulink data dictionary ButtonLogicData.sldd

ECU_SL_Status = Simulink.Parameter(0, DataType="uint8")
ECU_CC_Feature = Simulink.Parameter(0, DataType="uint8")
CCU_RCM_Feature = Simulink.Parameter(0, DataType="uint8")
CCU_RCM_Ready_Status = Simulink.Parameter(0, DataType="uint8")
ECU_SL_LED = Simulink.Parameter(0, DataType="uint8")
ECU_SL_Feature = Simulink.Parameter(0, DataType="uint8")
CCU_Status = Simulink.Parameter(eCCUStatus.installed, DataType="Enum: eCCUStatus")
CCU_TbT_Navigation_Feature = Simulink.Parameter(0, DataType="uint8")
CCU_Music_Feature = Simulink.Parameter(0, DataType="uint8")
heatingGrip = Simulink.Parameter(0, DataType="uint8")
BLU_MaxRndTimeLoopLim = Simulink.Parameter(98, DataType="uint8")
ECU_Quickshifter_Feature = Simulink.Parameter(0, DataType="uint8")
DASH_SL_Switch = Simulink.Parameter(0, DataType="uint8")
Heated_Grips = Simulink.Parameter(0, DataType="uint8")
CCU_BT_Status = Simulink.Parameter(0, DataType="uint8")
ABS_ABS_Mode_Response = Simulink.Parameter(eABSMode.road, DataType="Enum: eABSMode")
ABS_Launch_Control_Feature = Simulink.Parameter(1, DataType="uint16")
ABS_Mode_Feature = Simulink.Parameter(1, DataType="uint16")
ABS_TC_MTC_Mode_Feature = Simulink.Parameter(eTCMode.TCMode_TC, DataType="Enum: eTCMode")
ABS_TC_Mode_Response = Simulink.Parameter(0, DataType="uint16")
ECU_Drive_Mode_Response = Simulink.Parameter(0, DataType="uint16")
BLU_BTSearchDur_Tms = Simulink.Parameter(10000, DataType="uint16", Unit="msec")
BLU_ResDtctMin_Tms = Simulink.Parameter(50, DataType="uint16", Unit="msec")
BLU_ResDtctMax_Tms = Simulink.Parameter(2000, DataType="uint16", Unit="msec")
BLU_CCSetDtctMin_Tms = Simulink.Parameter(50, DataType="uint16", Unit="msec")
BLU_CCSetDtctMax_Tms = Simulink.Parameter(2000, DataType="uint16", Unit="msec")
BLU_CCDtctMin_Tms = Simulink.Parameter(50, DataType="uint16", Unit="msec")
BLU_CCDtctMax_Tms = Simulink.Parameter(2000, DataType="uint16", Unit="msec")
BLU_LngDwnDtcMax_Tms = Simulink.Parameter(5000, DataType="uint16", Unit="msec")
BLU_UpDtctMin_Tms = Simulink.Parameter(50, DataType="uint16", Unit="msec")
BLU_UpDtctMax_Tms = Simulink.Parameter(2000, DataType="uint16", Unit="msec")
BLU_LngUpDtctMin_Tms = Simulink.Parameter(3000, DataType="uint16", Unit="msec")
BLU_LngUpDtctMax_Tms = Simulink.Parameter(5000, DataType="uint16", Unit="msec")
BLU_LngDwnDtctMin_Tms = Simulink.Parameter(3000, DataType="uint16", Unit="msec")
BLU_LngDwnDtctMax_Tms = Simulink.Parameter(5000, DataType="uint16", Unit="msec")
BLU_DwnDtctMin_Tms = Simulink.Parameter(50, DataType="uint16", Unit="msec")
BLU_DwnDtctMax_Tms = Simulink.Parameter(2000, DataType="uint16", Unit="msec")
BLU_LngSetDtctMin_Tms = Simulink.Parameter(3000, DataType="uint16", Unit="msec")
BLU_LngSetDtctMax_Tms = Simulink.Parameter(5000, DataType="uint16", Unit="msec")
BLU_SetDtctMin_Tms = Simulink.Parameter(50, DataType="uint16", Unit="msec")
BLU_SetDtctMax_Tms = Simulink.Parameter(2000, DataType="uint16", Unit="msec")
BLU_LngExitDtctMin_Tms = Simulink.Parameter(3000, DataType="uint16", Unit="msec")
BLU_LngExitDtctMax_Tms = Simulink.Parameter(5000, DataType="uint16", Unit="msec")
BLU_ExitDtctMin_Tms = Simulink.Parameter(50, DataType="uint16", Unit="msec")
BLU_RND_TMR_LOOP = Simulink.Parameter(0, DataType="uint8")
CCU_Corded_Headset = Simulink.Parameter(0, DataType="uint8")
variant = Simulink.Parameter(eBikeVariant.duke200, DataType="Enum: eBikeVariant")
Sig = Simulink.Signal()
CCU_Connect = Simulink.Parameter(0, DataType="uint8")
BLU_PopUpHideDly_Tms = Simulink.Parameter(200, DataType="uint16", Unit="msec")
BLU_BTNewPhnPairWaitDur_Tms = Simulink.Parameter(3000, DataType="uint16", Unit="msec")
BLU_ExtraFnWtTmr_Tms = Simulink.Parameter(1000, DataType="uint16", Unit="msec")
BLU_LngBtnEvntDur_Tms = Simulink.Parameter(500, DataType="uint16", Unit="msec")
BLU_BTNewHdstPairWaitDur_Tms = Simulink.Parameter(1000)
BLU_ExitDtctMax_TmsCopy = Simulink.Parameter(2000, DataType="uint16", Unit="msec")
BLU_NavVolWaitDur_Tms = Simulink.Parameter(1000, DataType="uint16", Unit="msec")
BLU_ExitDtctMax_Tms = Simulink.Parameter(1000, DataType="uint16", Unit="msec")